# Dynamo graph script.dyn "Uni_NZ_Remove ASIA_AUS_IND" (Dynamo 2.12.1.8246)

code_block = CodeBlock { "Views"; "Sheets"; }

# group: Sheets
byName = Category.ByName(name=code_block.out1)
all_elements_of_category = ElementsOfCategory(Category=byName)

# group: Sheets Filter
code_block_2 = CodeBlock { "REGION"; }
getParameterValueByName = Element.GetParameterValueByName(element=all_elements_of_category, parameterName=code_block_2)
code_block_3 = CodeBlock { "ASIA"; "AUS"; "IND"; }
eq = getParameterValueByName == code_block_3.out0
filterByBoolMask = List.FilterByBoolMask(list=all_elements_of_category, mask=eq)
watch = Watch(filterByBoolMask.in)
eq_2 = getParameterValueByName == code_block_3.out1
filterByBoolMask_2 = List.FilterByBoolMask(list=all_elements_of_category, mask=eq_2)
watch_2 = Watch(filterByBoolMask_2.in)
eq_3 = getParameterValueByName == code_block_3.out2
filterByBoolMask_3 = List.FilterByBoolMask(list=all_elements_of_category, mask=eq_3)
watch_3 = Watch(filterByBoolMask_3.in)

# group: Views
byName_2 = Category.ByName(name=code_block.out0)
all_elements_of_category_2 = ElementsOfCategory(Category=byName_2)

# group: Views Filter
code_block_4 = CodeBlock { "REGION"; }
getParameterValueByName_2 = Element.GetParameterValueByName(element=all_elements_of_category_2, parameterName=code_block_4)
code_block_5 = CodeBlock { "ASIA"; "AUS"; "IND"; }
eq_4 = getParameterValueByName_2 == code_block_5.out0
filterByBoolMask_4 = List.FilterByBoolMask(list=all_elements_of_category_2, mask=eq_4)
watch_4 = Watch(filterByBoolMask_4.in)
eq_5 = getParameterValueByName_2 == code_block_5.out1
filterByBoolMask_5 = List.FilterByBoolMask(list=all_elements_of_category_2, mask=eq_5)
watch_5 = Watch(filterByBoolMask_5.in)
eq_6 = getParameterValueByName_2 == code_block_5.out2
filterByBoolMask_6 = List.FilterByBoolMask(list=all_elements_of_category_2, mask=eq_6)
watch_6 = Watch(filterByBoolMask_6.in)

# group: Careful!!!
delete = Element.Delete(element=filterByBoolMask_4.in)
delete_2 = Element.Delete(element=filterByBoolMask_5.in)
delete_3 = Element.Delete(element=filterByBoolMask_6.in)

# group: Careful!!!
delete_4 = Element.Delete(element=filterByBoolMask.in)
delete_5 = Element.Delete(element=filterByBoolMask_2.in)
delete_6 = Element.Delete(element=filterByBoolMask_3.in)
