# Dynamo graph renumber_viewports_by_location_v4_script.dyn (Dynamo 2.12.1.8246)

# group: Number of Cells
gridy_rows = CodeBlock { 5; }
# note: TODO make this a smart calc based on actual sheet size. ArchE1 30x42 is only supported now
gridx_columns = CodeBlock { 6; }

# group: Get the active sheet and viewports
current = Document.Current()
activeView = Document.ActiveView(document=current)
viewports = Sheet.Viewports(sheet=activeView)

boxOutline = Viewport.BoxOutline(viewport=viewports)
maxPoint = BoundingBox.MaxPoint(boundingBox=boxOutline)

# group: Get the size of the active sheet
python_script = Python(IN[0]=activeView)  # CPython3
# ---------- python_script.python (31 lines) ----------
#Alban de Chasteigner 2021
#twitter : @geniusloci_bim
#geniusloci.bim@gmail.com
#https://github.com/albandechasteigner/GeniusLociForDynamo

import clr
clr.AddReference('RevitAPI')
from Autodesk.Revit.DB import FilteredElementCollector,BuiltInParameter,BuiltInCategory

sheets = UnwrapElement(IN[0]) if isinstance(IN[0],list) else [UnwrapElement(IN[0])]

def convert_dimension_to_feet(dimension):
    feet, inches = dimension.split("'")
    feet = float(feet.strip())
    inches = inches.strip().replace('"', '').replace('-', '')
    print(inches.strip())
    inches = float(inches)
    total_feet = feet + (inches / 12)
    return total_feet

width,height=[],[]
for sheet in sheets:
	doc=sheet.Document
	title=FilteredElementCollector(doc,sheet.Id).OfCategory(BuiltInCategory.OST_TitleBlocks).FirstElement()
	width.append(title.get_Parameter(BuiltInParameter.SHEET_WIDTH).AsValueString())
	height.append(title.get_Parameter(BuiltInParameter.SHEET_HEIGHT).AsValueString())

if isinstance(IN[0], list):
    OUT = convert_dimension_to_feet(width),convert_dimension_to_feet(height)
else: 
    OUT =convert_dimension_to_feet(width[0]), convert_dimension_to_feet(height[0])
# ----------------------------------------
code_block = CodeBlock(x=python_script) { x[0]; x[1]; }
code_block_2 = CodeBlock(Width=code_block.out0) { Width; }
code_block_3 = CodeBlock(Height=code_block.out1) { Height; }

# group: Width of a cell
left_offset_in_the_x = CodeBlock { 0.2291667; }
sub = code_block_2 - left_offset_in_the_x
div = sub / gridx_columns

# group: Divide viewports x value by cell size to identify location on the sheet
X = Point.X(point=maxPoint)
div_2 = X / div  # lacing=Longest
code_block_4 = CodeBlock(x=div_2) { x+1; }
floor = Math.Floor(number=code_block_4)

reverse_the_x_matrix = Python(IN[0]=gridx_columns, IN[1]=floor)  # CPython3
# ---------- reverse_the_x_matrix.python (23 lines) ----------
# Load the Python Standard and DesignScript Libraries
import sys
import clr
clr.AddReference('ProtoGeometry')
from Autodesk.DesignScript.Geometry import *

# The inputs to this node will be stored as a list in the IN variables.
dataEnteringNode = IN
column_total = IN[0]
column_number = IN[1]
new_column_number = []
# Place your code below this line
def invert_column_number(column_number, num_columns):

    inverted_column = (num_columns - column_number) % num_columns
    return inverted_column

for c in column_number:
    new_number = invert_column_number(c, column_total)
    new_column_number.append(new_number)

# Assign your output to the OUT variable.
OUT = new_column_number
# ----------------------------------------

# group: Height of a cell
bottom_offset_y = CodeBlock { 0.04134114583333; }
sub_2 = code_block_3 - bottom_offset_y
div_3 = sub_2 / gridy_rows

# group: Divide viewports x value by cell size to identify location on the sheet
Y = Point.Y(point=maxPoint)
div_4 = Y / div_3  # lacing=Longest
code_block_5 = CodeBlock(y=div_4) { y+1; }
floor_2 = Math.Floor(number=code_block_5)

reverse_the_y_matrix = Python(IN[0]=gridy_rows, IN[1]=floor_2)  # CPython3
# ---------- reverse_the_y_matrix.python (23 lines) ----------
# Load the Python Standard and DesignScript Libraries
import sys
import clr
clr.AddReference('ProtoGeometry')
from Autodesk.DesignScript.Geometry import *

# The inputs to this node will be stored as a list in the IN variables.
dataEnteringNode = IN
column_total = IN[0]
column_number = IN[1]
new_column_number = []
# Place your code below this line
def invert_column_number(column_number, num_columns):

    inverted_column = (num_columns - column_number) % num_columns
    return inverted_column

for c in column_number:
    new_number = invert_column_number(c, column_total) +1
    new_column_number.append(new_number)

# Assign your output to the OUT variable.
OUT = new_column_number
# ----------------------------------------

# group: Giving all the info calculate the new viewport number
calculate_grid_number = Python(IN[0]=gridy_rows, IN[1]=reverse_the_x_matrix, IN[2]=reverse_the_y_matrix)  # CPython3
# ---------- calculate_grid_number.python (33 lines) ----------
# Load the Python Standard and DesignScript Libraries
import sys
import clr
clr.AddReference('ProtoGeometry')
from Autodesk.DesignScript.Geometry import *

clr.AddReference('System.Windows.Forms')
from System.Windows.Forms import MessageBox, MessageBoxButtons, MessageBoxIcon, DialogResult

# The inputs to this node will be stored as a list in the IN variables.
dataEnteringNode = IN
total_rows = IN[0]
column_numbers = IN[1]
row_numbers = IN[2]
new_cell_numbers = []

sheet_notes = MessageBox.Show('Are there notes on this sheet? If so viewport count will start from the second rightmost column.', 'Confirmation', MessageBoxButtons.YesNo, MessageBoxIcon.Question)

if sheet_notes == DialogResult.Yes:
    # 
    cell_offset = 5
    print(sheet_notes)
else:
    cell_offset = 0
    
for index, column_number in enumerate(column_numbers):
	
	cell_number = str((total_rows) * (column_number-1) + row_numbers[index] - cell_offset)
	new_cell_numbers.append(cell_number)
# Place your code below this line

# Assign your output to the OUT variable.
OUT = new_cell_numbers
# ----------------------------------------
code_block_6 = CodeBlock()
# ---------- code_block_6.designscript (5 lines) ----------
// IN[0] -> Total Rows on the sheet
// IN[1] -> Column Numbers
// IN[2] -> Row Numbers

// OUT[0] -> A list of the new viewport numbers
# ----------------------------------------

watch = Watch(calculate_grid_number)

# group: Set temporary detail numbers to avoid dupicates
code_block_7 = CodeBlock { "Detail Number"; }
getParameterValueByName = Element.GetParameterValueByName(element=viewports, parameterName=code_block_7)
code_block_8 = CodeBlock { "dup"; }
code_block_9 = CodeBlock(a=getParameterValueByName, b=code_block_8) { a+b; }
setParameterByName = Element.SetParameterByName(element=viewports, parameterName=code_block_7, value=code_block_9)

code_block_10 = CodeBlock { "Detail Number"; }
getParameterValueByName_2 = Element.GetParameterValueByName(element=setParameterByName, parameterName=code_block_10)
watch_2 = Watch(getParameterValueByName_2)
sheetName = Sheet.SheetName(sheet=activeView)
watch_3 = Watch(sheetName)

# group: Make sure dummy numbers are set first before the new numbers
sequential_passthrough = CodeBlock(passthrough=viewports, waitfor=getParameterValueByName_2) { [passthrough,waitfor][0]; }

code_block_11 = CodeBlock { "Detail Number"; }
setParameterByName_2 = Element.SetParameterByName(element=sequential_passthrough, parameterName=code_block_11, value=calculate_grid_number)
watch_4 = Watch(setParameterByName_2)
watch_5 = Watch(div)
watch_6 = Watch(maxPoint)

# group: testing
# note: Testing Line to show the point where each viewport location is being calculated from
create_line = Python(IN[0]=maxPoint)  # CPython3; frozen
# ---------- create_line.python (53 lines) ----------
# Import RevitAPI
import clr
clr.AddReference('RevitAPI')
from Autodesk.Revit.DB import *

# Import DocumentManager and TransactionManager
clr.AddReference('RevitServices')
from RevitServices.Persistence import DocumentManager
from RevitServices.Transactions import TransactionManager

# Import ToRevitType() extension method
clr.AddReference('RevitNodes')
import Revit
clr.ImportExtensions(Revit.GeometryConversion)

# Get the current document
doc = DocumentManager.Instance.CurrentDBDocument

# Get the list of points
points = IN[0]

# Get the red line style
line_style = FilteredElementCollector(doc).OfClass(GraphicsStyle).ToElements()
red_line_style = [style for style in line_style if style.Name == '01 - Ultra Light Red'][0]

# Start a transaction
TransactionManager.Instance.EnsureInTransaction(doc)

# Create a line for each point
for point in points:
    # Create a XYZ point at 0,0,0
    start_point = XYZ(0, 0, 0)
    
    # Convert Dynamo point to Revit XYZ point
    end_point = point.ToRevitType()
    
    # Project the end point onto the plane of the view
    end_point = XYZ(end_point.X, end_point.Y, 0)
    
    # Create a line from 0,0,0 to the point
    line = Line.CreateBound(start_point, end_point)
    
    # Create a detail line from the line
    detail_line = doc.Create.NewDetailCurve(doc.ActiveView, line)
    
    # Set the line style to red
    detail_line.LineStyle = red_line_style

# End the transaction
TransactionManager.Instance.TransactionTaskDone()

# Assign your output to the OUT variable
OUT = 0
# ----------------------------------------
