# Dynamo graph script.dyn (Dynamo 2.12.1.8246)
# packages: ParametricMonkey 1.3.6

# group: Install Parametric Monkey Package
code_block = CodeBlock { ["00_BASEBUILD", "01_FLOOR", "02_WALL", "03_JOINERY", "04_FFE", "05_ENTOURAGE", "Z_Linked_ARCH", "Z_Linked_MEP", "Z_Linked_STRUC", "Z_Linked_CAD"]; }
code_block_2 = CodeBlock { ["06_MASSING"]; }
code_block_3 = CodeBlock { ["99_LEVELS & GRIDS"]; }
createAndRenameDefault = Custom[Workset.CreateAndRenameDefault](newWorksetNames=code_block, sharedLevelsAndGridName=code_block_2, workset1Name=code_block_3)  # package ParametricMonkey
watch = Watch(createAndRenameDefault)
