# Dynamo graph script.dyn (Dynamo 2.12.1.8246)

code_block = CodeBlock { Revit.Category.ByName("Rooms"); }
all_elements_of_category = ElementsOfCategory(Category=code_block)
area = Room.Area(room=all_elements_of_category)
code_block_2 = CodeBlock(area=area) { area==0; }
filterByBoolMask = List.FilterByBoolMask(list=all_elements_of_category, mask=code_block_2)

# group: Check Elements to Delete
rooms_to_delete = Watch(filterByBoolMask.in)
name = Room.Name(room=rooms_to_delete)
number = Room.Number(room=rooms_to_delete)

# group: Set to True to Delete Elements on Rerunning the Script
boolean = BoolSelector(false)
code_block_3 = CodeBlock(x=boolean, pass=rooms_to_delete) { x==true?pass:null; }
delete = Element.Delete(element=code_block_3)
