# Dynamo graph script.dyn "Uni_Randon RotateEnscape_Script" (Dynamo 2.10.1.3976)

# note: Created By Unispace
# Kane Mannix

# group: Randomly Rotate Standing and Walking people, Bushes and Potted Plants
# note: code block used to hard code category for Dynamo Player
code_block = CodeBlock { "Planting"; }
byName = Category.ByName(name=code_block)
all_elements_of_category = ElementsOfCategory(Category=byName)
name = FamilyType.Name(familyType=all_elements_of_category)
code_block_2 = CodeBlock { "Walking"; }
boolean = BoolSelector(false)
contains = String.Contains(str=name, searchFor=code_block_2, ignoreCase=boolean)
filterByBoolMask = List.FilterByBoolMask(list=all_elements_of_category, mask=contains)
code_block_3 = CodeBlock { 1; 360; }
# note: Input set for Dynamo Player.
rotation_seed_slider = IntegerSlider(130, range=0..360 step 10)  # graph input
randomList = Math.RandomList(amount=code_block_3.out1, value1=code_block_3.out0, value2=code_block_3.out1, seed=rotation_seed_slider)
setRotation = FamilyInstance.SetRotation(familyInstance=filterByBoolMask.in, degree=randomList)
code_block_4 = CodeBlock { "Standing"; }
contains_2 = String.Contains(str=name, searchFor=code_block_4, ignoreCase=boolean)
filterByBoolMask_2 = List.FilterByBoolMask(list=all_elements_of_category, mask=contains_2)
setRotation_2 = FamilyInstance.SetRotation(familyInstance=filterByBoolMask_2.in, degree=randomList)
code_block_5 = CodeBlock { "Bush"; }
contains_3 = String.Contains(str=name, searchFor=code_block_5, ignoreCase=boolean)
filterByBoolMask_3 = List.FilterByBoolMask(list=all_elements_of_category, mask=contains_3)
setRotation_3 = FamilyInstance.SetRotation(familyInstance=filterByBoolMask_3.in, degree=randomList)
code_block_6 = CodeBlock { "Potted"; }
contains_4 = String.Contains(str=name, searchFor=code_block_6, ignoreCase=boolean)
filterByBoolMask_4 = List.FilterByBoolMask(list=all_elements_of_category, mask=contains_4)
setRotation_4 = FamilyInstance.SetRotation(familyInstance=filterByBoolMask_4.in, degree=randomList)
